# Dynamo graph listNodes.dyn (Dynamo 2.0.1.4650)

view_type = ViewTypesUi()  # nothing selected
dropdown_list = DropdownToListNodeModel(dropdown=view_type, Input=["AreaPlan", "CeilingPlan", "ColumnSchedule", "CostReport", "Detail", "DraftingView", "DrawingSheet", "Elevation", "EngineeringPlan", "FloorPlan", "Internal", "Legend", "LoadsReport", "PanelSchedule", "PresureLossReport", "ProjectBrowser", "Rendering", "Report", "Schedule", "Section", "SystemBrowser", "ThreeD", "Undefined", "View Template", "Walkthrough"])
watch = Watch(dropdown_list)
dropdown_list_selector = DropdownListSelector(List=dropdown_list)
watch_2 = Watch(dropdown_list_selector)
list_selector = ListSelector(List=dropdown_list)
watch_3 = Watch(list_selector)
